# Grasshopper definition 0_final facade gh.gh (Grasshopper 1.0.7)
# plug-ins: LunchBox

max_move = Slider(350, range=0..1000)
# input parameters
min_move = Slider(200, range=0..1000)

wall_height = Slider(4000, range=0..10000)
avg_distance_between = Slider(200, range=0..1000)

direction_switch = BooleanToggle(True)
offset_by = Slider(200, range=0..10000)

amplitude = Slider(600, range=0..1000)
d = Slider(1080, range=0..10000)

divide_line_into = Slider(15, range=0..5000)
repel_strength = Slider(800000, range=0..10000000)
door_height = Slider(2000, range=0..10000)
geometry_pipeline = GeometryPipeline(
    GroupByLayer=False,
    GroupByType=False,
    IncludeHidden=True,
    IncludeLocked=True,
    LayerFilter="repel points window",
    NameFilter="*",
    SublayerFiltering=True,
    TypeFilter=1)
geometry_pipeline_2 = GeometryPipeline(
    GroupByLayer=False,
    GroupByType=False,
    IncludeHidden=True,
    IncludeLocked=True,
    LayerFilter="repel points door",
    NameFilter="*",
    SublayerFiltering=True,
    TypeFilter=1)

# ----
# Bake result
# input plan curve
button = Button()
terracotta_thickness = Slider(80, range=0..1000)
plan_curve = Curve(<curve referenced from the Rhino model>)
cluster = Cluster_3(step=avg_distance_between, wall_height=wall_height, avg_dist=avg_distance_between)
move_z = MoveZ(geometry=plan_curve, factor=cluster)
curve = Curve(move_z)
cluster_2 = Cluster(switch=direction_switch, B=offset_by, curve=curve)  # -> a, curve_2
sine_offset = SineOffset(integer=cluster_2.a, curve=curve, curves=curve, z=cluster, A=amplitude, H=wall_height, d=d)
curves_1 = Curve(flatten(curve))
curves_2 = Curve(flatten(cluster_2.curve_2))
curves_3 = Curve(flatten(sine_offset))
cluster_3 = Cluster_2(
    door_height=door_height,
    curves=curves_1,
    repel_pts_door=geometry_pipeline_2,
    repel_pts_win=geometry_pipeline,
    num_pts_curve=divide_line_into,
    A=repel_strength)
cluster_4 = Cluster_2(
    door_height=door_height,
    curves=curves_2,
    repel_pts_door=geometry_pipeline_2,
    repel_pts_win=geometry_pipeline,
    num_pts_curve=divide_line_into,
    A=repel_strength)
cluster_5 = Cluster_2(
    door_height=door_height,
    curves=curves_3,
    repel_pts_door=geometry_pipeline_2,
    repel_pts_win=geometry_pipeline,
    num_pts_curve=divide_line_into,
    A=repel_strength)
curves_1_2 = Curve(flatten(cluster_3))
curves_2_2 = Curve(flatten(cluster_4))
curves_3_2 = Curve(flatten(cluster_5))
ghpython_script = GhPythonScript(curve1=curves_1_2, curve2=curves_2_2)  # -> out, a
# ---------- ghpython_script: Python ----------
import rhinoscriptsyntax as rs


# Create a list of curves to loft
curves = [curve1, curve2]

# Perform lofting
lofted_surface = rs.AddLoftSrf(curves, loft_type=2)

a = lofted_surface
# ---------- end ghpython_script ----------
ghpython_script_2 = GhPythonScript(curve1=curves_1_2, curve2=curves_3_2)  # -> out, a; same code as ghpython_script
surface = Surface(ghpython_script_2.a)
surface_2 = Surface(ghpython_script.a)
extrude_z = ExtrudeZ(base=surface_2, factor=avg_distance_between)
extrude_z_2 = ExtrudeZ(base=surface, factor=terracotta_thickness)
geometry = Geometry(extrude_z)
geometry_2 = Geometry(extrude_z_2)
merge = Merge(Data1=geometry, Data2=geometry_2)
object_bake = ObjectBake(
    BakeToggle=button,
    GeometryObjects=merge,
    Layer="brick",
    ObjectName="GH_Obj",
    ObjectColor=RGB(255, 255, 255),
    LayerColor=RGB(255, 255, 255))

# ==== cluster MoveZ
factor = ClusterInput()
unit_z = UnitZ(Factor=factor)
geometry = ClusterInput()
move = Move(Geometry=geometry, Motion=unit_z)  # -> Geometry, Transform
geometry_2 = ClusterOutput(move.Geometry)

# ==== cluster Cluster
switch = ClusterInput()
offset_direction_switch = GhPythonScript(switch=switch)  # -> out, a
# ---------- offset_direction_switch: Python ----------
a = 0

if switch==True:
    a = 1
else:
    a = -1

print(a)
# ---------- end offset_direction_switch ----------
a = ClusterOutput(offset_direction_switch.a)
B = ClusterInput()
xy_plane = XYPlane(Origin=Point(0, 0, 0))
multiplication = Multiplication(A=offset_direction_switch.a, B=B)
curve = ClusterInput()
offset_curve = OffsetCurve(Curve=curve, Distance=multiplication, Plane=xy_plane, Corners=1)
curve_2 = ClusterOutput(offset_curve)

# ==== cluster SineOffset
integer = ClusterInput()
integer_2 = Integer(integer)
curves = ClusterInput()
z = ClusterInput()
A = ClusterInput()
H = ClusterInput()
d = ClusterInput()
ghpython_script = GhPythonScript(curves=curves, switch=integer_2, z=z, A=A, H=H, d=d)  # -> out, O
# ---------- ghpython_script: Python ----------
import math

k = 2 * math.pi * (1/H)

O = (-1) * (A) * (math.sin(k*z))

a = switch

O = a * (O + d)

print(O)
O
# ---------- end ghpython_script ----------
xy_plane = XYPlane(Origin=Point(0, 0, 0))
curve = ClusterInput()
offset_curve = OffsetCurve(Curve=curve, Distance=ghpython_script.O, Plane=xy_plane, Corners=1)
curve_2 = ClusterOutput(offset_curve)

# ==== cluster Cluster_2
door_height = ClusterInput()
curves = ClusterInput()
repel_pts_door = ClusterInput()
repel_pts_win = ClusterInput()
num_pts_curve = ClusterInput()
A = ClusterInput()
ghpython_script = GhPythonScript(
    door_height=door_height,
    curves=curves,
    repel_pts_door=repel_pts_door,
    repel_pts_win=repel_pts_win,
    num_pts_curve=num_pts_curve,
    A=A)  # -> out, a; inputs curves: Curve, repel_pts_door: list of Point3d, repel_pts_win: list of Point3d
# ---------- ghpython_script: Python ----------
import rhinoscriptsyntax as rs
import Rhino.Geometry as rg


#reverse list order of repel points, count how many there are
repel_pts_door.reverse()
num_repel_pts_door = len(repel_pts_door)

repel_pts_win.reverse()
num_repel_pts_win = len(repel_pts_win)


#repel loop for doors
for lp in range(num_repel_pts_door):
    # Input curve
    curve = curves
    
    # Number of divisions
    num_divisions = num_pts_curve - 1
    
    # Divide the curve into points
    points_on_curve = rs.DivideCurve(curve, num_divisions, create_points=True)
    
    # Input point
    input_point = repel_pts_door[lp]
    
    # Initialize an empty list to store distances
    distances = []
    
    # Calculate distances from each point on the curve to the input point
    for point in points_on_curve:
        distance = rs.Distance(point, input_point)
        distances.append(distance)
    
    # Output the distances as an array
    d = distances
    
    # Find the numerically least value in the list
    min_value = min(d)
    print("min distance = " + str(min_value))
    
    # Is the repelling point above or below the points on the curve?
    closest_point_index = d.index(min_value) #index of numerically least value
    cpi = closest_point_index
    
    z_position_bool = True
    z_coor_pr = int(repel_pts_door[lp].Z)
    z_coor_pc = int(points_on_curve[cpi].Z)
    
    if z_coor_pr > z_coor_pc:
        z_position_bool = False
    
    
    # Calculating repel distance
    repel_dist = []
    influence_dist = 5500
    
    for i in range(int(num_pts_curve)):
        d_temp = d[i]
        if d_temp > influence_dist:
            repel_dist.append(0)
        else:
            dh = door_height
            d_temp = (A/(0.00012*d_temp*d_temp))
            
            repel_dist.append(d_temp)
    
    rd = repel_dist
    
    # Move the points up (Z-axis)
    for t in range(int(num_pts_curve)):
        point_to_move = points_on_curve[t]
        r_temp = rd[t]
        moved_point = rs.PointAdd(point_to_move, [0, 0, r_temp])
        points_on_curve[t] = moved_point
    
    # Interpolate points to form a new curve
    interpolated_curve = rs.AddInterpCurve(points_on_curve)
    curves = interpolated_curve


#repel loop for windows
for lp in range(num_repel_pts_win):
    # Input curve
    curve = curves
    
    # Number of divisions
    num_divisions = num_pts_curve - 1
    
    # Divide the curve into points
    points_on_curve = rs.DivideCurve(curve, num_divisions, create_points=True)
    
    # Input point
    input_point = repel_pts_win[lp]
    
    # Initialize an empty list to store distances
    distances = []
    
    # Calculate distances from each point on the curve to the input point
    for point in points_on_curve:
        distance = rs.Distance(point, input_point)
        distances.append(distance)
    
    # Output the distances as an array
    d = distances
    
    # Find the numerically least value in the list
    min_value = min(d)
    print("min distance = " + str(min_value))
    
    # Is the repelling point above or below the points on the curve?
    closest_point_index = d.index(min_value) #index of numerically least value
    cpi = closest_point_index
    
    z_position_bool = True
    z_coor_pr = int(repel_pts_win[lp].Z)
    z_coor_pc = int(points_on_curve[cpi].Z)
    
    if z_coor_pr > z_coor_pc:
        z_position_bool = False
    
    
    # Calculating repel distance
    repel_dist = []
    influence_dist = 2000
    
    for i in range(int(num_pts_curve)):
        d_temp = d[i]
        if d_temp > influence_dist:
            repel_dist.append(0)
        else:
            dh = door_height
            d_temp = (A/(0.001*d_temp*d_temp))
            
            repel_dist.append(d_temp)
    
    rd = repel_dist
    
    # Move the points up (Z-axis)
    for t in range(int(num_pts_curve)):
        point_to_move = points_on_curve[t]
        r_temp = rd[t]
        if not z_position_bool:
            r_temp = -r_temp
        moved_point = rs.PointAdd(point_to_move, [0, 0, r_temp])
        points_on_curve[t] = moved_point
    
    # Interpolate points to form a new curve
    interpolated_curve = rs.AddInterpCurve(points_on_curve)
    curves = interpolated_curve

a = curves
# ---------- end ghpython_script ----------
a = ClusterOutput(ghpython_script.a)

# ==== cluster ExtrudeZ
factor = ClusterInput()
unit_z = UnitZ(Factor=factor)
base = ClusterInput()
extrude = Extrude(Base=base, Direction=unit_z)
extrusion = ClusterOutput(extrude)

# ==== cluster Cluster_3
wall_height = ClusterInput()
avg_dist = ClusterInput()
ghpython_script = GhPythonScript(wall_height=wall_height, avg_dist=avg_dist)  # -> out, num
# ---------- ghpython_script: Python ----------
num = wall_height/avg_dist
num = int(num)
# ---------- end ghpython_script ----------
step = ClusterInput()
series = Series(Start="0", Step=step, Count=ghpython_script.num)
series_2 = ClusterOutput(series)
